# Requirement set YixuanMeng_Req (R2019b)

## 1 [#1] initialize pacemaker model
set values of AS,VS,AP,VP and basic cycles.

## 2 [#2] DDD pacemaker
pacemaker state, which including all five parts.

## 3 [#3] URI part
The pacemaker should not pace to increase the heart rate too high. So the minimum interval between a ventricular event and a ventricular pacing should be no less than URI.

## 4 [#4] init URI
Initially set enterURI to be true.

## 5 [#5] Idle URI state
When pacemaker is currently not in a URI period

## 6 [6] Activate URI period
Upon detecting a ventricular event, start a URI period until the period ends and allow VP to happen or another ventricular event happens before the period ends.

## 7 [7] go back to idle URI
after the count down of URI period end, VP can happen

## 8 [8] Activated state of URI
Indicates that less than URI time has passed after last ventricular event so no ventricular event should yet happen

## 9 [9] count down for URI
During the URI period, this transition serves as count down function until URI period ends or another ventricular event happens

## 10 [10] reset when VS or VP
During a URI period, another ventricular event is sensed, so the count down must be reset

## 11 [11] LRI part
The pacemaker should fulfil its intended use, which is maintaining a minimum ventricular rate. Therefore, the maximum interval between two consecutive ventricular events should be less or equal to LRI.

## 12 [12] init LRI
initialize count down variable tmpLRI, and initialize variables concerning AP

## 13 [13] Idle LRI state
when pacemaker is in a LRI period for no more than AEI time

## 14 [14] reset LRI period
if a ventricular event is detected in a LRI period, the count down variable should be reset

## 15 [15] count down
keep counting down in LRI period for no more than AEI time

## 16 [16] AS transition
if receive an AS in Idle state, go to activate state

## 17 [17] Activate state of LRI
Indicate that an atrial event has happened in a LRI period

## 18 [18] AP in a LRI period
If pacemaker enter active LRI state by generating an AP in a LRI period, set value of AP back to false

## 19 [19] Last AVI time in LRI
Do count down when atrial event has happened in a LRI period

## 20 [20] LRI period ends
At the end of LRI period, to keep minimum rate of ventricular events, pacemaker generate a VP

## 21 [21] LRIVP state
Indicates that a VP happened at the end of a LRI period

## 22 [22] back to Idle
The LRI period ends and VP generated, reset count down variable and restart from idle

## 23 [23] remain AVI time
If AEI time passed in LRI period, pacemaker generate an AP and enter active LRI state

## 24 [24] reset on ventricular event
if a ventricular event is detected before LRI period ends, reset LRI cycle.

## 25 [25] AVI part
AVI cycle ensures interval between an atrial event and a ventricular event is no more than AVI

## 26 [26] init avi
set VP variables to be false

## 27 [27] Idle avi state
Pacemaker stay in IdleAVI state when an AVI period has not been started

## 28 [28] Active AVI state
keep counting down in an AVI period

## 29 [29] enter active AVI state
start AVI period when an atrial event happens, set value of count down variable to be AVI

## 30 [30] back to Idle AVI state
when AVI period has not ended, but a ventricular event has been detected

## 31 [31] count down in active AVI
During an AVI period, if no VS or VP detected, keep counting down until AVI time passed

## 32 [32] end of AVI period
At the end of AVI period, give a VP to enforce maximum interval between A-V

## 33 [33] CAVI state
entered after an AVI period finished and VP generated

## 34 [34] reset VP
after generated VP at the end of AVI period, reset the value of VP to be false

## 35 [35] VRP part
Interval following a ventricular event during which ventricular senses would not inhibit or trigger pacing.

## 36 [36] init VRP
set VS to be false

## 37 [37] Idle VRP state
Stay in this IdleVRP when VRP period has not began

## 38 [38] enter VRPVS
when detect Vin, give VS and enter VRPVS

## 39 [39] VRPVS state
temporary state after receive an Vin

## 40 [40] enter Active VRP state after VS
set VS back to false and set value of count down variable

## 41 [41] Active VRP state
indicate that pacemaker is currently in a VRP period

## 42 [42] count down in VRP
During a VRP period, keep counting down until zero

## 43 [43] back to Idle VRP
when a VRP period ends, go back to Idle state

## 44 [44] enter active VRP when VP
When a VP is detected, start a VRP period

## 45 [45] PVARP part
Post-Ventricular Atrial Refractory Period Interval following a ventricular event during which atrial events would not inhibit atrial pacing or trigger ventricular pacing.

## 46 [46] init PVARP
set AS to false

## 47 [47] enter Ain PVARP
generate AS when Ain

## 48 [48] Ain PVARP state
When receiving an Ain signal, enter AinPVARP state, meanwhile generating an AS

## 49 [49] reset AS
reset AS back to false

## 50 [50] Idle PVARP
Stay in this IdlePVARP when PVARP period has not began

## 51 [51] enter active state when V
when a ventricular event is detected, start PVARP period

## 52 [52] Active PVARP state
indicates that pacemaker is currently in a PVARP period

## 53 [53] back to idle PVARP state
after PVARP period has finished, back to Idle PVARP

## 54 [54] count down in PVARP
During a PVARP period, count down until it ends or atrial event detected

## 55 [55] enter PVARP AR state
An atrial event happens during PVARP will be unsensed

## 56 [56] PVARP AR
indicates that an Ain happens in PVARP period thus should be unsensed

## 57 [57] back to active PVARP
reset AR to false, continue to count down