% Requirement links of YixuanMeng_SL_imp.slx (R2019b)

block :204 implements YixuanMeng_Req.slreqx#1: initialize pacemaker model
block :204:122 implements YixuanMeng_Req.slreqx#2: DDD pacemaker
block :204:122 implements YixuanMeng_Req.slreqx#57: 56: PVARP AR
block :204:123 implements YixuanMeng_Req.slreqx#1: initialize pacemaker model
block :204:525 implements YixuanMeng_Req.slreqx#41: 40: enter Active VRP state
block :204:526 implements YixuanMeng_Req.slreqx#37: 36: init VRP
block :204:527 implements YixuanMeng_Req.slreqx#44: 43: back to Idle VRP
block :204:528 implements YixuanMeng_Req.slreqx#36: 35: VRP part
block :204:529 implements YixuanMeng_Req.slreqx#40: 39: VRPVS state
block :204:530 implements YixuanMeng_Req.slreqx#38: 37: Idle VRP state
block :204:531 implements YixuanMeng_Req.slreqx#42: 41: Active VRP state
block :204:532 implements YixuanMeng_Req.slreqx#39: 38: enter VRPVS
block :204:533 implements YixuanMeng_Req.slreqx#45: 44: enter active VRP when VP
block :204:534 implements YixuanMeng_Req.slreqx#43: 42: count down in VRP
block :204:561 implements YixuanMeng_Req.slreqx#50: 49: reset AS
block :204:563 implements YixuanMeng_Req.slreqx#49: 48: Ain PVARP state
block :204:564 implements YixuanMeng_Req.slreqx#58: 57: back to active PVARP
block :204:565 implements YixuanMeng_Req.slreqx#51: 50: Idle PVARP
block :204:566 implements YixuanMeng_Req.slreqx#53: 52: Active PVARP state
block :204:567 implements YixuanMeng_Req.slreqx#47: 46: init PVARP
block :204:568 implements YixuanMeng_Req.slreqx#52: 51: enter active state when V
block :204:569 implements YixuanMeng_Req.slreqx#54: 53: back to idle PVARP state
block :204:570 implements YixuanMeng_Req.slreqx#55: 54: count down in PVARP
block :204:571 implements YixuanMeng_Req.slreqx#56: 55: enter PVARP AR state
block :204:572 implements YixuanMeng_Req.slreqx#46: 45: PVARP part
block :204:572 implements YixuanMeng_Req.slreqx#52: 51: enter active state when V
block :204:573 implements YixuanMeng_Req.slreqx#48: 47: enter Ain PVARP
block :204:574 implements YixuanMeng_Req.slreqx#27: 26: init avi
block :204:575 implements YixuanMeng_Req.slreqx#35: 34: reset VP
block :204:576 implements YixuanMeng_Req.slreqx#32: 31: count down in active AVI
block :204:578 implements YixuanMeng_Req.slreqx#33: 32: end of AVI period
block :204:579 implements YixuanMeng_Req.slreqx#31: 30: back to Idle AVI state
block :204:580 implements YixuanMeng_Req.slreqx#29: 28: Active AVI state
block :204:581 implements YixuanMeng_Req.slreqx#34: 33: CAVI state
block :204:582 implements YixuanMeng_Req.slreqx#26: 25: AVI part
block :204:583 implements YixuanMeng_Req.slreqx#28: 27: Idle avi state
block :204:584 implements YixuanMeng_Req.slreqx#3: URI part
block :204:585 implements YixuanMeng_Req.slreqx#4: init URI
block :204:586 implements YixuanMeng_Req.slreqx#10: 9: count down for URI
block :204:587 implements YixuanMeng_Req.slreqx#5: Idle URI state
block :204:588 implements YixuanMeng_Req.slreqx#9: 8: Activated state of URI
block :204:589 implements YixuanMeng_Req.slreqx#11: 10: reset when VS or VP
block :204:591 implements YixuanMeng_Req.slreqx#8: 7: go back to idle URI
block :204:592 implements YixuanMeng_Req.slreqx#12: 11: LRI part
block :204:592 implements YixuanMeng_Req.slreqx#23: 22: back to Idle
block :204:593 implements YixuanMeng_Req.slreqx#18: 17: Activate state of LRI
block :204:594 implements YixuanMeng_Req.slreqx#16: 15: count down
block :204:595 implements YixuanMeng_Req.slreqx#23: 22: back to Idle
block :204:596 implements YixuanMeng_Req.slreqx#22: 21: LRIVP state
block :204:597 implements YixuanMeng_Req.slreqx#13: 12: init LRI
block :204:598 implements YixuanMeng_Req.slreqx#15: 14: reset LRI period
block :204:599 implements YixuanMeng_Req.slreqx#24: 23: remain AVI time
block :204:600 implements YixuanMeng_Req.slreqx#25: 24: reset on ventricular event
block :204:601 implements YixuanMeng_Req.slreqx#17: 16: AS transition
block :204:602 implements YixuanMeng_Req.slreqx#21: 20: LRI period ends
block :204:603 implements YixuanMeng_Req.slreqx#14: 13: Idle LRI state
block :204:604 implements YixuanMeng_Req.slreqx#19: 18: AP in a LRI period
block :204:605 implements YixuanMeng_Req.slreqx#20: 19: AVI part in LRI
block :204:616 implements YixuanMeng_Req.slreqx#7: 6: Activate URI period
block :204:617 implements YixuanMeng_Req.slreqx#30: 29: enter active AVI state